# Grasshopper definition Mobius pipe_XX_hops.gh (Grasshopper 1.0.8)
# plug-ins: RhinoCodePluginGH, Pufferfish

size_z = Slider(2.2, range=0..10)
size_x = Slider(6, range=0..10)
size_y = Slider(6, range=0..10)
size_z_2 = Slider(5, range=0..10)
twist = Slider(3, range=0..10)
twist_2 = GetNumber(twist, AtLeast=1, AtMost=1, Maximum=1.797693135e+308, Minimum=-1.797693135e+308, TreeAccess=False)
sizex = GetNumber(size_x, AtLeast=1, AtMost=1, Maximum=1.797693135e+308, Minimum=-1.797693135e+308, TreeAccess=False)
sizey = GetNumber(size_y, AtLeast=1, AtMost=1, Maximum=1.797693135e+308, Minimum=-1.797693135e+308, TreeAccess=False)
sizey_2 = GetNumber(size_z, AtLeast=1, AtMost=1, Maximum=1.797693135e+308, Minimum=-1.797693135e+308, TreeAccess=False)
ucount = GetInteger(Slider(1, range=1..30), AtLeast=1, AtMost=1, Maximum=2147483647, Minimum=-2147483648, TreeAccess=False)
vcount = GetInteger(Slider(9, range=2..10), AtLeast=1, AtMost=1, Maximum=2147483647, Minimum=-2147483648, TreeAccess=False)
radius = GetNumber(Slider(0.03, range=0..0.1), AtLeast=1, AtMost=1, Maximum=1.797693135e+308, Minimum=-1.797693135e+308, TreeAccess=False)
py3 = Python3Script(a=twist_2, b=sizex, c=sizey, d=size_z_2, e=Slider(1, range=0..1))  # -> out, a, surface
# ---------- py3: Python ----------
import Rhino.Geometry as rg
import math

# Parameters
u_div = 100  # Divisions along U
v_div = 20   # Divisions along V
u_min, u_max = 0, 2 * math.pi
v_min, v_max = -1, 1

# Twist control (number of half-twists)
twists = a

# Step sizes for parametric variables
u_step = (u_max - u_min) / u_div * e
v_step = (v_max - v_min) / v_div 

# Create a 2D array (list of lists) of points for the NURBS surface
points = []

for i in range(u_div + 1):
    row = []
    u = u_min + i * u_step
    for j in range(v_div + 1):
        v = v_min + j * v_step
        
        # Mobius strip parametric equations
        x = (1 + (v / 2) * math.cos(twists * u / 2)) * math.cos(u) * b
        y = (1 + (v / 2) * math.cos(twists * u / 2)) * math.sin(u) * c
        z = (v / 2) * math.sin(twists * u / 2) * d
        
        point = rg.Point3d(x, y, z)
        row.append(point)  # Add the point to the row
    points.append(row)  # Add the row to the points list

# Flatten the 2D list of points into a single list
flat_points = [pt for sublist in points for pt in sublist]

# Ensure that the points are in a grid and the number of points matches the divisions
u_count = len(points)
v_count = len(points[0])

# Create a NURBS surface from the flattened list of points
nurbs_surface = rg.NurbsSurface.CreateThroughPoints(flat_points, u_count, v_count, 3, 3, False, False)

# Output the NURBS surface
a = nurbs_surface
# ---------- end py3 ----------
offsrf = OffsetSurface(Surface=py3.a, Distance=sizey_2, BothSides=expr("-x", sizey_2), CreateSolid=size_z_2)
panel = Panel("""0
1
2
4""")
debrep = DeconstructBrep(Brep=offsrf)  # -> Faces, Edges, Vertices
item = ListItem(List=debrep.Faces, Index=panel, Wrap=True)
divide = DivideDomain²(Domain=item, UCount=ucount, VCount=vcount)
subsrf = Isotrim(Surface=graft(item), Domain=divide)
debrep_2 = DeconstructBrep(Brep=subsrf)  # -> Faces, Edges, Vertices
flatten = FlattenTree(Tree=debrep_2.Edges, Path="{0}")
pipe = Pipe(Curve=flatten, Radius=radius, Caps=0)
context_bake = ContextBake(Content=pipe)
